# Grasshopper definition multiple curve attractors.gh (Grasshopper 0.9.75)

# HEIGHT AND DISTANCE ATTRACTORS
number_slider = Slider(3, range=-2..100)
crv = Curve([<curve referenced from the Rhino model> x3])
series = Series(Start=0, Step=number_slider, Count=Slider(40, range=-2..100))
# CREATE INITIAL FIELD OF POINTS
crossref = CrossReference(ListA=series, ListB=series, CrossMode=1)  # -> ListA, ListB
graft = GraftTree(Tree=crv, IncludeEmptyLists=True, IncludeNullItems=True)
pt = ConstructPoint(XCoordinate=crossref.ListA, YCoordinate=crossref.ListB, ZCoordinate=0)
crv_cp = CurveClosestPoint(Point=pt, Curve=graft)  # -> Point, Parameter, Distance
dist = Distance(PointA=crv_cp.Point, PointB=pt)
eval = Evaluate(F="x<10", x=dist)
dispatch = Dispatch(List=pt, DispatchPattern=eval)  # -> ListA, ListB
# COMPARE POINTS WITHIN
# EVAL FUNCTION TO ORGINAL CURVE
crv_cp_2 = CurveClosestPoint(Point=dispatch.ListA, Curve=graft)  # -> Point, Parameter, Distance
dist_2 = Distance(PointA=dispatch.ListA, PointB=crv_cp_2.Point)
Z = UnitZ(Factor=dist_2)
rev = Reverse(Vector=Z)
move = Move(Geometry=dispatch.ListA, Motion=rev)  # -> Geometry, Transform
box = CenterBox(Base=move.Geometry, X="1.5", Y="1.5", Z="1.5")
