# Grasshopper definition Sphere Cube Conidtion.gh (Grasshopper 0.9.75)

number_slider = Slider(0, range=0..20)
number_slider_2 = Slider(5, range=0..20)
number_slider_3 = Slider(14, range=0..20)
series = Series(Start=number_slider, Step=number_slider_2, Count=number_slider_3)
series_2 = Series(Start=number_slider, Step=number_slider_2, Count=number_slider_3)
series_3 = Series(Start=number_slider, Step=number_slider_2, Count=number_slider_3)
cross_reference = CrossReference(ListListA=series, ListListB=series_2, ListA=series_3, CrossMode=1)  # -> ListListA, ListListB, ListA
panel = Panel(series)
A = ConstructPoint(XCoordinate=cross_reference.ListListA, YCoordinate=cross_reference.ListListB, ZCoordinate=cross_reference.ListA)
panel_2 = Panel(A)
pdecon = Deconstruct(Point=A)  # -> XComponent, YComponent, ZComponent
panel_3 = Panel(pdecon.XComponent)
eval = Evaluate(F="x>20", x=pdecon.XComponent)
panel_4 = Panel(eval)
dispatch = Dispatch(List=A, DispatchPattern=eval)  # -> ListA, ListB
sphere = Sphere(Base=dispatch.ListA, Radius=Slider(1, range=0..20))
sphere_2 = Sphere(Base=dispatch.ListB, Radius=Slider(3, range=0..20))
