# Grasshopper definition graph mapper.gh (Grasshopper 0.9.75)

series = Series(Start=0, Step=Slider(8, range=0..20), Count=Slider(8, range=0..20))
circle = CircleCNR(Center=Point(0, 0, 0), Normal=Vector(0, 0, 1), Radius=Slider(9, range=0..20))
Z = UnitZ(Factor=series)
move = Move(Geometry=circle, Motion=Z)  # -> Geometry, Transform
dom = ConstructDomain(DomainStart=Slider(0.345, range=-20..20), DomainEnd=Slider(0.852, range=0..20))
boundary = BoundarySurfaces(Edges=move.Geometry)
pt = Point(move.Geometry)
range = Range(Domain=dom, Steps=pt)
panel = Panel(pt)
extr = Extrude(Base=boundary, Direction=Vector(0, 0, 1.549678289))
graph = GraphMapper(range, x0=0, x1=1, y0=0, y1=1, container_name="Power", Gx=0.4420289993, Gy=0.6056337953, power=0.6142726463)
scale = Scale(Geometry=extr, Center=pt, Factor=graph)  # -> Geometry, Transform
