# Grasshopper definition pyramid morphing.gh (Grasshopper 0.9.75)

number_slider = Slider(15, range=0..30)
srf = Surface(reparameterize(<surface referenced from the Rhino model>))
number_slider_2 = Slider(25, range=0..30)
srf_2 = Surface(reparameterize(<surface referenced from the Rhino model>))
flip = Flip(Surface=srf)  # -> Surface, Result
divide = DivideDomain²(Domain=flip.Surface, UCount=number_slider, VCount=number_slider)
divide_2 = DivideDomain²(Domain=srf_2, UCount=number_slider_2, VCount=number_slider_2)
geo = Geometry(<brep referenced from the Rhino model>)
sbox = SurfaceBox(Surface=flip.Surface, Domain=divide, Height=Slider(10, range=0..30))
geo_2 = Geometry(<brep referenced from the Rhino model>)
sbox_2 = SurfaceBox(Surface=srf_2, Domain=divide_2, Height=Slider(10, range=0..30))
morph = BoxMorph(Geometry=geo, Reference=geo, Target=sbox)
morph_2 = BoxMorph(Geometry=geo_2, Reference=geo_2, Target=sbox_2)
