# Grasshopper definition Studio I_Sauna V1.gh (Grasshopper 0.9.75)

srf = Surface(<surface referenced from the Rhino model>)
divide = DivideDomain²(Domain=srf, UCount=Slider(32, range=0..32), VCount=Slider(20, range=0..20))
number_slider = Slider(10, range=0..10)
dom = ConstructDomain(DomainStart=0, DomainEnd=1)
range = Range(Domain=Domain(0, 1), Steps=10)
geo = Geometry(<brep referenced from the Rhino model>)
sbox = SurfaceBox(Surface=srf, Domain=divide, Height=Slider(0.5, range=0..1))
graph = GraphMapper(x0=0, x1=1, y0=0, y1=1, A=1, B=0, container_name="Linear", Graph_x0=0.25, Graph_x1=0.75, Graph_y0=0.25, Graph_y1=0.75)
dom_2 = ConstructDomain(DomainStart=Slider(0, range=0..10), DomainEnd=Slider(10, range=0..10))
morph = BoxMorph(Geometry=geo, Reference=geo, Target=sbox)
random = Random(Range=dom_2, Number=Slider(10, range=0..10), Seed=2)
number_slider_2 = Slider(20, range=0..20)
panel = Panel(graph)
reduce = RandomReduce(List=morph, Reduction=Slider(248, range=0..250), Seed=1)
pt = ConstructPoint(XCoordinate=random, YCoordinate=0, ZCoordinate=0)  # disabled
extr = Extrude(Base=reduce, Direction=Vector(0, -3.913893982, 0))
