# Grasshopper definition brick gradient.gh (Grasshopper 0.9.75)

# even
# course
total = Slider(24, range=0..50)
dist_bwtn = Slider(5, range=0..12)
dist_bwtn_2 = Slider(8, range=0..20)
total_ht = Slider(27, range=0..50)
start = Slider(1.25, range=0..5)
# SINGLE WYETH WALLS NEED TO BE STRUCTURAL BRICK, NOT FACE BRICK
# 
# FACEBRICK: 8BETWEENx5 BETWEEN; 8X4X2.5
# STRUC. BRICK = 8Dx4Hx16L
# *Units are inches
# *V1 had feet: slider 1.0-1.4; box: .5x.25x1.0
# WISH LIST:
# - ENCAPSULATE COMPONENTS INTO FUNCTIONS TO DUPLICATE
# - MORE TYPE FLEXIBILITY
# - MORE NESTING FUNCTIONS OR DUPLICATE OUTPUT
start_2 = Slider(-92, range=-96..16)
start_3 = Slider(-80, range=-96..16)
dist_bwtn_3 = Slider(8, range=0..20)
# odd
# course
total_2 = Slider(24, range=0..50)
start_4 = Slider(-88, range=-96..16)
start_5 = Slider(-88, range=-96..16)
start_6 = Slider(3.75, range=0..12)
total_ht_2 = Slider(26, range=0..50)
dist_bwtn_4 = Slider(5, range=0..8)
# solid
series = Series(Start=start_2, Step=dist_bwtn_2, Count=total)
series_2 = Series(Start=start, Step=dist_bwtn, Count=total_ht)
number_slider = Slider(16, range=0..20)
number_slider_2 = Slider(23, range=0..30)
series_3 = Series(Start=start_5, Step=dist_bwtn_3, Count=total_2)
series_4 = Series(Start=start_6, Step=dist_bwtn_4, Count=total_ht_2)
crossref = CrossReference(ListA=series, ListB=series_2, CrossMode=1)  # -> ListA, ListB
len_from_center = Slider(4, range=0..20)
width_from_center = Slider(2, range=0..20)
crossref_2 = CrossReference(ListA=series_3, ListB=series_4, CrossMode=1)  # -> ListA, ListB
ht_from_center = Slider(1.25, range=0..20)
len_from_center_2 = Slider(4, range=0..20)
width_from_center_2 = Slider(2, range=0..20)
ht_from_center_2 = Slider(1.25, range=0..20)
pt = ConstructPoint(XCoordinate=crossref.ListA, YCoordinate=0, ZCoordinate=crossref.ListB)
# //after a certain amount of small steps
# (>20) - gradient is less pronounced - willl want 1/3 solid!
number_slider_3 = Slider(8, range=0..20)
pt_2 = ConstructPoint(XCoordinate=crossref_2.ListA, YCoordinate=0, ZCoordinate=crossref_2.ListB)
item = ListItem(List=pt, Index=-1, Wrap=True)
item_2 = ListItem(List=pt_2, Index=-1, Wrap=True)
box = CenterBox(Base=pt, X=len_from_center, Y=width_from_center, Z=ht_from_center)
dom = ConstructDomain(DomainStart=number_slider_3, DomainEnd=Slider(11.375, range=0..30))
box_2 = CenterBox(Base=pt_2, X=len_from_center_2, Y=width_from_center_2, Z=ht_from_center_2)
pdecon = Deconstruct(Point=item)  # -> XComponent, YComponent, ZComponent
pdecon_2 = Deconstruct(Point=item_2)  # -> XComponent, YComponent, ZComponent
range = Range(Domain=dom, Steps=Slider(22, range=0..50))
addition = Addition(A=pdecon.XComponent, B=dist_bwtn_2)
graph = GraphMapper(
    range,
    x0=0,
    x1=1,
    y0=0,
    y1=1,
    A=1.093060173,
    B=-0.02326504322,
    container_name="Linear",
    Graph_x0=0.25,
    Graph_x1=0.6376811862,
    Graph_y0=0.25,
    Graph_y1=0.6737588644)
addition_2 = Addition(A=pdecon_2.XComponent, B=dist_bwtn_3)
total_3 = Slider(2, range=0..50)
total_4 = Slider(2, range=0..50)
ma = MassAddition(Input=graph)  # -> Result, PartialResults
# gradient
series_5 = Series(Start=addition, Step=ma.PartialResults, Count=total_3)
series_6 = Series(Start=start, Step=dist_bwtn, Count=total_ht)
addition_3 = Addition(A=ma.PartialResults, B=Slider(0, range=0..20))
series_7 = Series(Start=addition_2, Step=addition_3, Count=total_4)
series_8 = Series(Start=start_6, Step=dist_bwtn_4, Count=total_ht_2)
crossref_3 = CrossReference(ListA=series_5, ListB=series_6, CrossMode=1)  # -> ListA, ListB
crossref_4 = CrossReference(ListA=series_7, ListB=series_8, CrossMode=1)  # -> ListA, ListB
pt_3 = ConstructPoint(XCoordinate=crossref_3.ListA, YCoordinate=0, ZCoordinate=crossref_3.ListB)
pt_4 = ConstructPoint(XCoordinate=crossref_4.ListA, YCoordinate=0, ZCoordinate=crossref_4.ListB)
box_3 = CenterBox(Base=pt_3, X=len_from_center, Y=width_from_center, Z=ht_from_center)
box_4 = CenterBox(Base=pt_4, X=len_from_center_2, Y=width_from_center_2, Z=ht_from_center_2)
