# Grasshopper definition Studio I_Sauna V2.gh (Grasshopper 0.9.75)

bwtn_bricks = Slider(0.798, range=0..1)
dom = ConstructDomain(DomainStart=Slider(0.25, range=0..1), DomainEnd=Slider(30, range=0..30))
number_slider = Slider(8, range=0..10)
range = Range(Domain=dom, Steps=Slider(60, range=0..60))
cos = Cosine(Value=range)
pt = ConstructPoint(XCoordinate=range, YCoordinate=cos, ZCoordinate=0)
btwen_bricks = Slider(0.23, range=0..1)
Z = UnitZ(Factor=number_slider)
intcrv = Interpolate(Vertices=pt, Degree=3, Periodic=False, KnotStyle=1)  # -> Curve, Length, Domain
divdist = DivideDistance(Curve=intcrv.Curve, Distance=bwtn_bricks)  # -> Points, Tangents, Parameters
line = LineSDL(Start=divdist.Points, Direction=Z, Length=number_slider)
divdist_2 = DivideDistance(Curve=line, Distance=btwen_bricks)  # -> Points, Tangents, Parameters
xy = XYPlane(Origin=divdist_2.Points)
flip = FlipMatrix(Data=xy)
align = AlignPlane(Plane=flip, Direction=divdist.Tangents)  # -> Plane, Angle
flip_2 = FlipMatrix(Data=align.Plane)
dispatch = Dispatch(List=flip_2, DispatchPattern=[True, False])  # -> ListA, ListB
flip_3 = FlipMatrix(Data=dispatch.ListA)
flip_4 = FlipMatrix(Data=dispatch.ListB)
dispatch_2 = Dispatch(List=flip_4, DispatchPattern=[True, False])  # -> ListA, ListB
dispatch_3 = Dispatch(List=flip_3, DispatchPattern=[True, False])  # -> ListA, ListB
pln = Plane(dispatch_2.ListB)
pln_2 = Plane(dispatch_3.ListA)
box = CenterBox(Base=pln, X=Slider(0.5, range=0..1), Y=Slider(0.25, range=0..1), Z=Slider(0.125, range=0..1))
box_2 = CenterBox(Base=pln_2, X=Slider(0.5, range=0..1), Y=Slider(0.25, range=0..1), Z=Slider(0.125, range=0..1))
