# Grasshopper definition Studio I_Sauna V3.gh (Grasshopper 0.9.75)

# *Units are inches
# *V1 had feet: slider 1.0-1.4; box: .5x.25x1.0
# WISH LIST:
# - ENCAPSULATE COMPONENTS INTO FUNCTIONS TO DUPLICATE
# - MORE TYPE FLEXIBILITY
# - MORE NESTING FUNCTIONS OR DUPLICATE OUTPUT
# //HOW TO JUST PULL X - VALUE TO TEST AGAINST;
# RUN CULL PATTERN AND INFILL
# BACK FILL REGULARLY? OR MOVE TO THE FRONT?
number_slider = Slider(8, range=0..12)
# //after a certain amount of small steps (>20) - gradient is less pronounced - willl want 1/3 solid!
number_slider_2 = Slider(17, range=0..50)
dom = ConstructDomain(DomainStart=number_slider, DomainEnd=Slider(11.75, range=0..20))
range = Range(Domain=dom, Steps=number_slider_2)
graph = GraphMapper(
    range,
    x0=0,
    x1=1,
    y0=0,
    y1=1,
    A=1,
    B=0,
    container_name="Linear",
    Graph_x0=0.25,
    Graph_x1=0.75,
    Graph_y0=0.25,
    Graph_y1=0.75)
panel = Panel(graph)
ma = MassAddition(Input=graph)  # -> Result, PartialResults
panel_2 = Panel(ma.PartialResults)
total = Slider(2, range=0..50)
dist_bwtn = Slider(8, range=0..12)
dist_bwtn_2 = Slider(8, range=0..12)
total_2 = Slider(2, range=0..50)
dist_bwtn_3 = Slider(5, range=0..12)
start = Slider(4, range=-1..5)
total_3 = Slider(24, range=0..50)
start_2 = Slider(8, range=0..16)
start_3 = Slider(1.25, range=0..5)
start_4 = Slider(3.75, range=0..12)
total_4 = Slider(24, range=0..50)
dist_bwtn_4 = Slider(5, range=0..5)
series = Series(Start=start, Step=ma.PartialResults, Count=total)
series_2 = Series(Start=start_3, Step=dist_bwtn_3, Count=total_3)
series_3 = Series(Start=start_2, Step=ma.PartialResults, Count=total_2)
series_4 = Series(Start=start_4, Step=dist_bwtn_4, Count=total_4)
crossref = CrossReference(ListA=series, ListB=series_2, CrossMode=1)  # -> ListA, ListB
crossref_2 = CrossReference(ListA=series_3, ListB=series_4, CrossMode=1)  # -> ListA, ListB
len_from_center = Slider(4, range=0..20)
dom_2 = ConstructDomain(DomainStart=Slider(0.125, range=0..2), DomainEnd=Slider(0.4, range=0..5))
width_from_center = Slider(2, range=0..20)
ht_from_center = Slider(1.25, range=0..20)
len_from_center_2 = Slider(4, range=0..20)
width_from_center_2 = Slider(2, range=0..20)
ht_from_center_2 = Slider(1.25, range=0..20)
dom_3 = ConstructDomain(DomainStart=Slider(0.125, range=0..2), DomainEnd=Slider(0.4, range=0..5))
range_2 = Range(Domain=dom_2, Steps=10)
pt = ConstructPoint(XCoordinate=crossref_2.ListA, YCoordinate=0, ZCoordinate=crossref_2.ListB)
range_3 = Range(Domain=dom_3, Steps=10)
pt_2 = ConstructPoint(XCoordinate=crossref.ListA, YCoordinate=0, ZCoordinate=crossref.ListB)
graph_2 = GraphMapper(
    reverse(range_2),
    x0=0,
    x1=1,
    y0=0,
    y1=1,
    A=1,
    B=0,
    container_name="Linear",
    Graph_x0=0.25,
    Graph_x1=0.75,
    Graph_y0=0.25,
    Graph_y1=0.75)
graph_3 = GraphMapper(
    reverse(range_3),
    x0=0,
    x1=1,
    y0=0,
    y1=1,
    A=1,
    B=0,
    container_name="Linear",
    Graph_x0=0.25,
    Graph_x1=0.75,
    Graph_y0=0.25,
    Graph_y1=0.75)
box = CenterBox(Base=pt, X=len_from_center, Y=width_from_center, Z=ht_from_center)
box_2 = CenterBox(Base=pt_2, X=len_from_center_2, Y=width_from_center_2, Z=ht_from_center_2)
pdecon = Deconstruct(Point=pt)  # -> XComponent, YComponent, ZComponent
len_from_center_3 = Slider(2, range=0..20)
width_from_center_3 = Slider(2, range=0..20)
ht_from_center_3 = Slider(2, range=0..20)
eval = Evaluate(F="x>30", x=pdecon.XComponent)
dispatch = Dispatch(List=pt, DispatchPattern=eval)  # -> ListA, ListB
panel_3 = Panel(dispatch.ListB)
panel_4 = Panel(dispatch.ListA)
box_3 = CenterBox(Base=PlaneXY(0, 0, 0), X=len_from_center_3, Y=width_from_center_3, Z=ht_from_center_3)
