# Grasshopper definition topomorph.gh (Grasshopper 0.9.75)

# MORPHED PANELING
srf = Surface(reparameterize(<surface referenced from the Rhino model>))
divide = DivideDomain²(Domain=srf, UCount="30", VCount="30")
sbox = SurfaceBox(Surface=srf, Domain=divide, Height=1)
debrep = DeconstructBrep(Brep=sbox)  # -> Faces, Edges, Vertices
item = ListItem(List=debrep.Vertices, Index="1", Wrap=True)
pdecon = Deconstruct(Point=item)  # -> XComponent, YComponent, ZComponent
eval = Evaluate(F="x>25", x=pdecon.ZComponent)  # -> flatten(r)
# yes flatten eval. the issue:
# checking every vertice vs the
# number of boxes - just check each
# box once not 4 times.
dispatch = Dispatch(List=sbox, DispatchPattern=eval)  # -> ListA, ListB
geo = Geometry(<brep referenced from the Rhino model>)
geo_2 = Geometry(<brep referenced from the Rhino model>)
morph = BoxMorph(Geometry=geo, Reference=geo, Target=dispatch.ListA)
morph_2 = BoxMorph(Geometry=geo_2, Reference=geo_2, Target=dispatch.ListB)
merge = Merge(Data1=morph, Data2=morph_2)
