# Grasshopper definition Sphere Cube (2).gh (Grasshopper 0.9.75)

number_slider = Slider(0, range=0..20)
number_slider_2 = Slider(10, range=0..20)
number_slider_3 = Slider(9, range=0..20)
series = Series(Start=number_slider, Step=number_slider_3, Count=number_slider_2)
series_2 = Series(Start=number_slider, Step=number_slider_3, Count=number_slider_2)
series_3 = Series(Start=number_slider, Step=number_slider_3, Count=number_slider_2)
cross_reference = CrossReference(ListListA=series, ListListB=series_2, ListA=series_3, CrossMode=1)  # -> ListListA, ListListB, ListA
panel = Panel(series)
construct_point = ConstructPoint(XCoordinate=cross_reference.ListListA, YCoordinate=cross_reference.ListListB, ZCoordinate=cross_reference.ListA)
sphere = Sphere(Base=construct_point, Radius=2)
