# Grasshopper definition diagrid.gh (Grasshopper 0.9.75)

sphere = Geometry(<brep referenced from the Rhino model>)
plane = Geometry(<brep referenced from the Rhino model>)
torus = Geometry(<brep referenced from the Rhino model>)
curvy = Geometry(<brep referenced from the Rhino model>)
divide = DivideDomain²(Domain=curvy, UCount=Slider(8, range=0..10), VCount=Slider(8, range=0..10))
subsrf = Isotrim(Surface=curvy, Domain=divide)
debrep = DeconstructBrep(Brep=subsrf)  # -> Faces, Edges, Vertices
item = ListItem(List=debrep.Vertices, Index=Slider(1, range=0..10), Wrap=True)
item_2 = ListItem(List=debrep.Vertices, Index=Slider(2, range=0..10), Wrap=True)
item_3 = ListItem(List=debrep.Vertices, Index=Slider(0, range=0..10), Wrap=True)
item_4 = ListItem(List=debrep.Vertices, Index=Slider(3, range=0..10), Wrap=True)
ln = Line(StartPoint=item_3, EndPoint=item_2)
ln_2 = Line(StartPoint=item, EndPoint=item_4)
number_slider = Slider(1, range=0..10)
pipe = Pipe(Curve=ln_2, Radius=number_slider, Caps=0)
pipe_2 = Pipe(Curve=ln, Radius=number_slider, Caps=0)
