# Grasshopper definition graph mapper bulge.gh (Grasshopper 0.9.75)

start = Slider(0, range=0..10)
end = Slider(10, range=0..10)
start_2 = Slider(0, range=0..10)
end_2 = Slider(10, range=0..10)
dom = ConstructDomain(DomainStart=start, DomainEnd=end)
dom_2 = ConstructDomain(DomainStart=start_2, DomainEnd=end_2)
range = Range(Domain=dom, Steps=10)
range_2 = Range(Domain=dom_2, Steps=10)
graph = GraphMapper(flatten(range_2), x0=0, x1=10, y0=0, y1=10, container_name="Bezier", cpx=[0, 0, 0.9921309948, 1], cpy=[1, 0, 1, 0])
graph_2 = GraphMapper(flatten(range), x0=0, x1=10, y0=0, y1=10, container_name="Bezier", cpx=[0, 0, 1, 1], cpy=[0, 1, 0, 0.7452457547])
panel = Panel(range)
panel_2 = Panel(range_2)
panel_3 = Panel(graph_2)
pt = ConstructPoint(XCoordinate=range, YCoordinate=graph_2, ZCoordinate=0)
panel_4 = Panel(graph)
pt_2 = ConstructPoint(XCoordinate=range_2, YCoordinate=graph, ZCoordinate=0)
intcrv = Interpolate(Vertices=pt, Degree=3, Periodic=False, KnotStyle=1)  # -> Curve, Length, Domain
offset_depth = Slider(10, range=0..15)
Z = UnitZ(Factor=offset_depth)
intcrv_2 = Interpolate(Vertices=pt_2, Degree=3, Periodic=False, KnotStyle=1)  # -> Curve, Length, Domain
move = Move(Geometry=intcrv.Curve, Motion=Z)  # -> Geometry, Transform
rulesrf = RuledSurface(CurveA=intcrv_2.Curve, CurveB=move.Geometry)
panel_count = Slider(15, range=0..15)
panel_count_2 = Slider(0.05, range=0..2)
divide = DivideDomain²(Domain=rulesrf, UCount=panel_count, VCount=panel_count)
sbox = SurfaceBox(Surface=rulesrf, Domain=divide, Height=panel_count_2)
geo = Geometry(<brep referenced from the Rhino model>)
morph = BoxMorph(Geometry=geo, Reference=geo, Target=sbox)
