# Grasshopper definition sine morphing.gh (Grasshopper 0.9.75)

range = Range(Domain=Slider(30.661, range=0..62.831), Steps=Slider(22.566, range=0..37.699))
range_2 = Range(Domain=Slider(30.661, range=0..62.831), Steps=Slider(22.566, range=0..37.699))
sin = Sine(Value=range)
sin_2 = Sine(Value=range_2)
pt = ConstructPoint(XCoordinate=range, YCoordinate=sin, ZCoordinate=0)
pt_2 = ConstructPoint(XCoordinate=range_2, YCoordinate=sin_2, ZCoordinate=0)
Z = UnitZ(Factor=Slider(8, range=0..10))
move = Move(Geometry=pt_2, Motion=Z)  # -> Geometry, Transform
ln = Line(StartPoint=pt, EndPoint=move.Geometry)
loft = Loft(Curves=ln, Options={Adjust=False, Closed=False, LoftEnds=0, LoftSimp=0, LoftType=0, Rebuild=10, Refit=0.01})
divide = DivideDomain²(Domain=loft, UCount=Slider(20, range=0..20), VCount=Slider(16, range=0..20))
geo = Geometry(<brep referenced from the Rhino model>)
sbox = SurfaceBox(Surface=loft, Domain=divide, Height=Slider(1, range=0..1))
morph = BoxMorph(Geometry=geo, Reference=geo, Target=sbox)  # disabled
